% Simulink data dictionary fMPC.sldd

eyem = [1 0 0; 0 1 0; 0 0 1]

eyen = [1 0 0 0 0 0 0 0 0 0 0 0
 0 1 0 0 0 0 0 0 0 0 0 0
 0 0 1 0 0 0 0 0 0 0 0 0
 0 0 0 1 0 0 0 0 0 0 0 0
 0 0 0 0 1 0 0 0 0 0 0 0
 0 0 0 0 0 1 0 0 0 0 0 0
 0 0 0 0 0 0 1 0 0 0 0 0
 0 0 0 0 0 0 0 1 0 0 0 0
 0 0 0 0 0 0 0 0 1 0 0 0
 0 0 0 0 0 0 0 0 0 1 0 0
 0 0 0 0 0 0 0 0 0 0 1 0
 0 0 0 0 0 0 0 0 0 0 0 1]

k = 1
kappa = Simulink.Parameter(0.01, DataType="double")
m = Simulink.Parameter(3, DataType="int32")
n = Simulink.Parameter(12, DataType="int32")
niters = Simulink.Parameter(5, DataType="int32")
nm = Simulink.Parameter(15)  % n+m
nz = Simulink.Parameter(150, DataType="int32")

Q = Simulink.Parameter([1 0 0 0 0 0 0 0 0 0 0 0
 0 1 0 0 0 0 0 0 0 0 0 0
 0 0 1 0 0 0 0 0 0 0 0 0
 0 0 0 1 0 0 0 0 0 0 0 0
 0 0 0 0 1 0 0 0 0 0 0 0
 0 0 0 0 0 1 0 0 0 0 0 0
 0 0 0 0 0 0 1 0 0 0 0 0
 0 0 0 0 0 0 0 1 0 0 0 0
 0 0 0 0 0 0 0 0 1 0 0 0
 0 0 0 0 0 0 0 0 0 1 0 0
 0 0 0 0 0 0 0 0 0 0 1 0
 0 0 0 0 0 0 0 0 0 0 0 1], DataType="double")

Qf = Simulink.Parameter([1 0 0 0 0 0 0 0 0 0 0 0
 0 1 0 0 0 0 0 0 0 0 0 0
 0 0 1 0 0 0 0 0 0 0 0 0
 0 0 0 1 0 0 0 0 0 0 0 0
 0 0 0 0 1 0 0 0 0 0 0 0
 0 0 0 0 0 1 0 0 0 0 0 0
 0 0 0 0 0 0 1 0 0 0 0 0
 0 0 0 0 0 0 0 1 0 0 0 0
 0 0 0 0 0 0 0 0 1 0 0 0
 0 0 0 0 0 0 0 0 0 1 0 0
 0 0 0 0 0 0 0 0 0 0 1 0
 0 0 0 0 0 0 0 0 0 0 0 1], DataType="double")

t = 0.02390859
T = Simulink.Parameter(10, DataType="int32")
ts = 0.5
tvec = [0 0.5 1 1.5 2 2.5 3 3.5 4 4.5]
umax = [0.5; 0.5; 0.5]
Umax = 0.5
umin = [-0.5; -0.5; -0.5]

w = [0 0 0 0 0 0 0 0 0 0 0 0 0
 0.2 0 0 0 0 0 0 -0.04353233 -0.4814964 0.3214072 -0.05529664 0.1154323 0.291937
 0.4 0 0 0 0 0 0 -0.08972979 0.3936495 -0.4421087 -0.147131867783 0.3131665 -0.4901387
 0.6 0 0 0 0 0 0 -0.4847261 0.2467857 -0.05490357 0.4318146 -0.03400566 -0.08135053
 0.8 0 0 0 0 0 0 0.1812772 -0.120519 0.331796 0.002812884 0.2094714 -0.07110763
 1 0 0 0 0 0 0 -0.349127 0.1978985 -0.121627 0.3600116 0.3536551 0.09356291
 1.2 0 0 0 0 0 0 -0.1580294 -0.2102741 -0.1588064 0.03407902 0.2271132 -0.1907098
 1.4 0 0 0 0 0 0 0.1945672 0.1213101 0.2948211 0.4568434 0.02259035 0.3801422
 1.6 0 0 0 0 0 0 -0.3634813 -0.4882433 0.393898 -0.3008619 -0.201277 0.1614426
 1.8 0 0 0 0 0 0 0.01551175 -0.1660485 -0.0670934 -0.2740501 0.07980687 0.260365
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 ]

W = [0 0 0 0 0 0 0 0 0 0 0 0
 0 0 0 0 0 0 0 0 0 0 0 0
 0 0 0 0 0 0 0 0 0 0 0 0
 0 0 0 0 0 0 0 0 0 0 0 0
 0 0 0 0 0 0 0 0 0 0 0 0
 0 0 0 0 0 0 0 0 0 0 0 0
 0 0 0 0 0 0 0.08333333 0 0 0 0 0
 0 0 0 0 0 0 0 0.08333333 0 0 0 0
 0 0 0 0 0 0 0 0 0.08333333 0 0 0
 0 0 0 0 0 0 0 0 0 0.08333333 0 0
 0 0 0 0 0 0 0 0 0 0 0.08333333 0
 0 0 0 0 0 0 0 0 0 0 0 0.08333333]

x0 = [0; 0; 0; 0; 0; 0; -0.04353233; -0.4814964; 0.3214072; -0.05529664; 0.1154323; 0.291937]

Xhist = [0 0 -0.04760357 -0.1504306 -0.3500991 -0.2401356 -0.1512779 -0.06857145 0.1201578 0.09586565
 0 0 -0.1977043 -0.1098202 0.03014458 -0.04442828 -0.09638363 -0.2347449 -0.209962 -0.2757599
 0 0 0.141872 0.0248426 -0.08382421 0.02572146 0.1043321 0.1560267 0.3176777 0.516727
 0 0 -0.002554664 -0.02104342 0.1558427 0.1963468 0.2809358 0.303042 0.4859353 0.4801593
 0 0 0.0538516 0.1899464 0.1518167 0.159178 0.3078457 0.4723916 0.5836682 0.6501336
 0 0 0.1221075 -0.0300662 -0.1037463 -0.03047108 0.2210703 0.3982923 0.7300119 0.9584261
 0 -0.04353233 -0.2454006 -0.6258237 0.05395904 0.01188703 0.1661165 0.3336012 0.02808897 -0.1113023
 0 -0.4814964 0.1256903 0.4391712 -0.0496519 -0.0195643 -0.3755983 -0.021799 -0.3418658 -0.06145451
 0 0.3214072 -0.2369497 -0.2604485 0.2028592 0.09227653 0.05277168 0.4301606 0.6005498 0.08887549
 0 -0.05529664 -0.08500722 0.4476263 0.2204082 0.3046921 0.07265599 0.4871945 -0.06435077 -0.2093833
 0 0.1154323 0.4141316 0.05884849 0.01332691 0.3781344 0.4470152 0.2228591 0.04574429 0.3075024
 0 0.291937 -0.3096473 -0.3432264 -0.01348715 0.3884187 0.3972388 0.6758796 0.7659345 0.3752505]

xmax = Simulink.Parameter(repmat(4, 12, 1), DataType="double")
xmin = Simulink.Parameter(repmat(-4, 12, 1), DataType="double")
z = Simulink.Parameter(repmat(0, 15, 10), DataType="double")
z0 = Simulink.Parameter(repmat(0, 15, 10), DataType="double")

zmax = Simulink.Parameter([4 4 4 4 4 4 4 4 4 4
 4 4 4 4 4 4 4 4 4 4
 4 4 4 4 4 4 4 4 4 4
 12 12 12 12 12 12 12 12 12 12
 12 12 12 12 12 12 12 12 12 12
 12 12 12 12 12 12 12 12 12 12
 12 12 12 12 12 12 12 12 12 12
 12 12 12 12 12 12 12 12 12 12
 12 12 12 12 12 12 12 12 12 12
 12 12 12 12 12 12 12 12 12 12
 12 12 12 12 12 12 12 12 12 12
 12 12 12 12 12 12 12 12 12 12
 12 12 12 12 12 12 12 12 12 12
 12 12 12 12 12 12 12 12 12 12
 12 12 12 12 12 12 12 12 12 12], DataType="double")

zmin = Simulink.Parameter([-4 -4 -4 -4 -4 -4 -4 -4 -4 -4
 -4 -4 -4 -4 -4 -4 -4 -4 -4 -4
 -4 -4 -4 -4 -4 -4 -4 -4 -4 -4
 -12 -12 -12 -12 -12 -12 -12 -12 -12 -12
 -12 -12 -12 -12 -12 -12 -12 -12 -12 -12
 -12 -12 -12 -12 -12 -12 -12 -12 -12 -12
 -12 -12 -12 -12 -12 -12 -12 -12 -12 -12
 -12 -12 -12 -12 -12 -12 -12 -12 -12 -12
 -12 -12 -12 -12 -12 -12 -12 -12 -12 -12
 -12 -12 -12 -12 -12 -12 -12 -12 -12 -12
 -12 -12 -12 -12 -12 -12 -12 -12 -12 -12
 -12 -12 -12 -12 -12 -12 -12 -12 -12 -12
 -12 -12 -12 -12 -12 -12 -12 -12 -12 -12
 -12 -12 -12 -12 -12 -12 -12 -12 -12 -12
 -12 -12 -12 -12 -12 -12 -12 -12 -12 -12], DataType="double")

R_Weights = Simulink.Parameter([1 0 0; 0 1 0; 0 0 1], DataType="double")